# Grasshopper definition BoxTest.gh (Grasshopper 0.9.76)
# plug-ins: Colibri, CORE.Grasshopper.Spectacles

length = Slider(1, range=1..10)
width = Slider(4, range=1..10)
height = Slider(10, range=1..10)
panel = Panel("""3
4
2""")
box = CenterBox(Base=PlaneXY(0, 0, 0), X=length, Y=width, Z=height)
brep = Brep(box)
iterator = Iterator(Sliders=[length, width, height], Steps=panel, Fly=Button())
volume = Volume(Geometry=brep)  # -> Volume, Centroid
panel_2 = Panel(iterator)
imageparameter = ImageParameter(WidthInput="400", HeightInput="400", Bool=Toggle(False))
formatoutputs = FormatOutputs(OutputNames="Volume", OutputValues=volume.Volume)
swatch = ColourSwatch(SwatchColor=RGB(255, 0, 140))
toggle = BooleanToggle(True)
spectacles_meshlambertmaterial = Spectacles_MeshLambertMaterial(Color=swatch, AmbientColor=swatch, EmissiveColor=RGB(0, 0, 0), Object_Opacity=1, SmoothEdges=True)
aggregator = Aggregator(
    FolderPath="C:\Users\bhowes\Desktop\Colibri\Box_1210",
    InputsDataSet=iterator,
    OutputsDataSet=formatoutputs,
    ImageParams=imageparameter,
    WriteFile=toggle)  # -> WriteInData, SpectaclesFileName
spectacles_mesh = Spectacles_Mesh(Mesh=brep, MeshMaterial=spectacles_meshlambertmaterial)
spectacles_scenecompiler = Spectacles_SceneCompiler(Write=toggle, FilePath=aggregator.SpectaclesFileName, Elements=flatten(spectacles_mesh))
