# Grasshopper definition Iterator2Testing.gh (Grasshopper 0.9.76)
# plug-ins: Colibri

number_slider = Slider(10, range=0..10)
ddd = Panel("dddg")
iterator = Iterator2(Inputs=Slider(0.484, range=0..1), Fly=Toggle(True))
panel = Panel(iterator)
